# Grasshopper definition MIDAS Grillage & Piles_WIP.gh (Grasshopper 1.0.7)
# plug-ins: Human, Wombat

# ---- group: Cross Sect Inputs
# Step 1: Modifying the Input
# Input A (Tranverse Grillage): Choose one of the below purple options for the span arrangement.
# Then connect 'D' to 'I' for the chosen option.
width_of_x_section = Slider(22, range=0..30)
edge_dist = Slider(0.6, range=0..30)
no_increments = Slider(11, range=0..30)

# ---- group: Span by increm
# Input B (Longtidunal Grillage): Choose one of the below purple options for the span arrangement.
# Then connect 'D' to 'I' for the chosen option.
span = Slider(28.5, range=0..30)
no_increments_2 = Slider(20, range=0..30)

# ---- group: Pile Inputs
# Input C (Pile Increment): Choose one of the below purple options for the span arrangement.
# Then connect 'D' to 'I' for the chosen option.
pile = Slider(25.5, range=0..30)
no_increments_3 = Slider(10, range=0..30)

# ---- group: Span by seg length
seg_length = Slider(2.85, range=0..40)
# OR
span_2 = Slider(28.5, range=0..40)

# ----
division = Division(A=width_of_x_section, B=no_increments)
division_2 = Division(A=span, B=no_increments_2)
division_3 = Division(A=span_2, B=seg_length)
division_4 = Division(A=pile, B=no_increments_3)
dup = DuplicateData(Data=division, Number=no_increments, Order=True)
dup_2 = DuplicateData(Data=division_2, Number=no_increments_2, Order=True)
dup_3 = DuplicateData(Data=seg_length, Number=division_3, Order=True)
dup_4 = DuplicateData(Data=division_4, Number=no_increments_3, Order=True)
entwine = Entwine(Branch00=0, Branch01=dup_4, FlattenInputs=True)  # -> flatten(Result)
ma = MassAddition(Input=entwine)  # -> Result, PartialResults
entwine_2 = Entwine(Branch00=0, Branch01=edge_dist, Branch02=dup, Branch03=edge_dist, FlattenInputs=True)  # -> flatten(Result)
neg = Negative(Value=ma.PartialResults)
ma_2 = MassAddition(Input=entwine_2)  # -> Result, PartialResults
ma_3 = MassAddition(Input=dup_2)  # -> Result, PartialResults
Z = UnitZ(Factor=neg)
entwine_3 = Entwine(Branch00=0, Branch01=ma_3.PartialResults, FlattenInputs=True)  # -> flatten(Result)
pt = ConstructPoint(XCoordinate=0, YCoordinate=0, ZCoordinate=0)
Y = UnitY(Factor=ma_2.PartialResults)
move = Move(Geometry=pt, Motion=Y)  # -> Geometry, Transform
X = UnitX(Factor=entwine_3)
pline = PolyLine(Vertices=move.Geometry, Closed=False)
move_2 = Move(Geometry=pline, Motion=X)  # -> Geometry, Transform
explode = Explode(Curve=move_2.Geometry, Recursive=True)  # -> Segments, Vertices
flip = FlipMatrix(Data=explode.Vertices)
tstat = TreeStatistics(Tree=explode.Segments)  # -> Paths, Length, Count
pline_2 = PolyLine(Vertices=flip, Closed=False)
panel = Panel("""0
-1""")
explode_2 = Explode(Curve=pline_2, Recursive=True)  # -> Segments, Vertices
panel_2 = Panel("""0
-1""")
tstat_2 = TreeStatistics(Tree=explode_2.Segments)  # -> Paths, Length, Count
cull_i = CullIndex(List=tstat_2.Paths, Indices=panel_2, Wrap=True)
item = ListItem(List=tstat_2.Paths, Index=panel_2, Wrap=True)  # -> Item1, Item
item_2 = ListItem(List=tstat.Paths, Index=panel, Wrap=True)  # -> Item1, Item
cull_i_2 = CullIndex(List=tstat.Paths, Indices=panel, Wrap=True)

# ---- group: Elements to 'bake'
# Bake this only for transverse members, if seperation into edge transverse + transverse is NOT required.
transverse = Geometry(explode.Segments)  # disabled
edge_long = TreeBranch(Tree=explode_2.Segments, Path=item.Item, MaintainPaths=True)
# Note: if edge dist is not specified / required, then 'bake' edge long and girders together into 1 layer.
girders = TreeBranch(Tree=explode_2.Segments, Path=cull_i, MaintainPaths=True)
edge_trans = TreeBranch(Tree=explode.Segments, Path=item_2.Item, MaintainPaths=True)
transverse_2 = TreeBranch(Tree=explode.Segments, Path=cull_i_2, MaintainPaths=True)

# ----
entwine_4 = Entwine(Branch00=edge_trans, Branch01=transverse_2, Branch02=edge_long, Branch03=girders, FlattenInputs=True)
move_3 = Move(Geometry=graft(explode.Vertices), Motion=Z)  # -> Geometry, Transform; disabled

# ----
# File Format Sample: *if format not in sample, refer
# https://www.rhino3d.com/features/file-formats/
# Output E (Double Click the black button to to create the export): After completing Output A,B and C, double click on the black button to create CAD file
output_curve = Geometry(entwine_4)
ready_to_create_dwg_double_click_the_bla = BooleanToggle(False)  # "Ready to Create .dwg? Double Click the black Button"
# Step 2 : Bake Geometry from Rhino to DWG Format
output_a_double_click_to_modify_layer_na = Panel("""Edge Trans
Tranverse
Edge Longitudinal
Girders""")  # "Output A (Double Click to modify Layer Name)"
output_c_double_click_to_modify_file_nam = Panel("Grillage_Model_WIP")  # "Output C (Double Click to Modify File Name)"
output_d_double_click_to_modify_file_for = Panel(".dwg")  # "Output D (Double Click to Modify File Format)"
output_b_double_click_to_modify_file_pat = Panel("C:\Users\wei90562\OneDrive - Mott MacDonald\Grasshopper_Session")  # "Output B (Double Click to Modify File Path)"
path_mapper = PathMapper(output_curve, source="{A;B}", target="{B;0}")
path_mapper_2 = PathMapper(output_a_double_click_to_modify_layer_na, source="{A}(i)", target="{i;0}")
file_format_sample = Panel(""".dwg
.dxf
.igs
.stp
.step
.sat""")
concat = Concatenate(
    FragmentA=output_b_double_click_to_modify_file_pat,
    FragmentB="\",
    FragmentC=output_c_double_click_to_modify_file_nam,
    FragmentD=output_d_double_click_to_modify_file_for)
lng = ListLength(List=path_mapper)
data = Data(graft(path_mapper_2))
dup_5 = DuplicateData(Data=data, Number=lng, Order=True)
panel_3 = Panel(concat)
layers = CreateModifyLayers(LayerName=data, DeleteLayer=False, enableFullPath=False)  # -> LayerNames, LayerFullPath; disabled
export = ExportFileToPath(
    Run=ready_to_create_dwg_double_click_the_bla,
    GeometryToExport=simplify(flatten(path_mapper)),
    ExportPath=concat,
    LayerNames=simplify(flatten(dup_5)))
